# Dynamo graph ExportRoomParameters_JP.dyn (Dynamo 2.19.3.6394)
# Export room parameters to Excel (Japanese parameter names)

string = StringInput("Book1.xlsx")
file_path = Filename("..\Documents\24\Book1.xlsx")
code_block = CodeBlock { "Sheet1"; }
code_block_2 = CodeBlock { 1; }
code_block_3 = CodeBlock { 0; }
code_block_4 = CodeBlock { "Rooms"; }
byName = Category.ByName(name=code_block_4)
all_elements_of_category = ElementsOfCategory(Category=byName)
code_block_5 = CodeBlock { "番号"; }
getParameterValueByName = Element.GetParameterValueByName(element=all_elements_of_category, parameterName=code_block_5)
code_block_6 = CodeBlock { "名前"; }
getParameterValueByName_2 = Element.GetParameterValueByName(element=all_elements_of_category, parameterName=code_block_6)
code_block_7 = CodeBlock { "面積"; }
getParameterValueByName_3 = Element.GetParameterValueByName(element=all_elements_of_category, parameterName=code_block_7)
code_block_8 = CodeBlock { "コメント"; }
getParameterValueByName_4 = Element.GetParameterValueByName(element=all_elements_of_category, parameterName=code_block_8)
code_block_9 = CodeBlock(a=getParameterValueByName, b=getParameterValueByName_2, c=getParameterValueByName_3, d=getParameterValueByName_4) { [a,b,c,d]; }
transpose = List.Transpose(lists=code_block_9)
boolean = BoolSelector(true)
exportExcel = Data.ExportExcel(filePath=file_path, sheetName=code_block, startRow=code_block_2, startColumn=code_block_3, data=transpose, overWrite=boolean)
exportToExcel = Data.ExportToExcel()  # unwired: filePath, sheetName, startRow, startColumn, data
